# Grasshopper definition AutoPanel3.gh (Grasshopper 1.0.7)
# plug-ins: ScriptParasite, EleFront, MetaHopper, Heteroptera, Human, froGH

layertable = LayerTable(Update=Button(), AutoUpdate=False)  # -> Layers, FullLayerPaths, LayerColors, Linetypes, MaterialNames, Visible, PrintWidth, PrintColor
python = GhPythonScript(x=layertable.Layers)  # -> flatten(a), flatten(b); inputs x: list
# ---------- python: Python ----------
__author__ = "riccardo"
__version__ = "2023.02.27"

import rhinoscriptsyntax as rs

list = []
list2 = []

for i in x:
    if (i.split('-')[0] == 'dir'):
        list.append(i)
    if (i.split('-')[0] == 'obs'):
        list2.append(i)

list.sort()

a = list
b = list2
# ---------- end python ----------
panel = Panel(python.a)
panel_2 = Panel("""Librerie aggiuntive:
Elefront
Human
MetaHopper
Heteroptera""")
counter = Counter()
panel_3 = Panel(python.b)
# Ordine dei Layers da Rhino:
# 
# 'dir'   => PARENT LAYER
# -------------------
# > 'dir-nborder'  => 1 POLILINEA (BORDO)
# 
# > 'dir-nh-x.x'     => N LINEE (FUGHE H)
# > ...
# > 'dir-nv-x.x'     => N LINEE (FUGHE V)
# > ...
# > obs-n[...]       => N POLILINEE (OSTACOLI)
# > ...
# -------------------
f_ghfilepath = GHFilePathInfo()  # -> FileName, FilePath

panel_4 = Panel("""dir-0border
dir-0h-2.2
dir-0h-8.8
dir-0v-8.8
dir-1border
dir-1h-2.2
dir-1h-8.8
dir-1v-8.8
dir-2border
dir-2h-2.2
dir-2h-8.8
dir-2v-8.8
dir-3border
dir-3h-2.2
dir-3h-8.8
dir-3v-8.8
dir-4border
dir-4h-2.2
dir-4h-8.8
dir-4v-8.8
dir-5border
dir-5h-2.2
dir-5h-8.8
dir-5v-8.8
dir-6border
dir-6h-2.2
dir-6h-8.8
dir-6v-8.8
dir-7border
dir-7h-2.2
dir-7h-8.8
dir-7v-8.8""")
panel_5 = Panel("CONTROLLO MANUALE LAYERS")

panel_6 = Panel("""obs-0windows
obs-0detach
obs-0pavement
obs-0other
obs-1windows
obs-1detach
obs-1pavement
obs-1other
obs-2windows
obs-2detach
obs-2pavement
obs-2other
obs-3windows
obs-3detach
obs-3pavement
obs-3other
obs-4windows
obs-4detach
obs-4pavement
obs-4other
obs-5windows
obs-5detach
obs-5pavement
obs-5other
obs-6windows
obs-6detach
obs-6pavement
obs-6other
obs-7windows
obs-7detach
obs-7pavement
obs-7other""")
reflay = ReferenceByLayer(LayerName=panel_6)  # -> simplify(Geometry)

reflay_2 = ReferenceByLayer(LayerName="baseline")  # -> simplify(Baseline)
reflay_3 = ReferenceByLayer(LayerName=panel_4)
merge = Merge(Data1=graft(panel_4), Data2=reflay_3)  # -> simplify(Result)

# ---- group: GENERATOR
c_script = CSharpScript(x=merge, y=reflay, z=reflay_2)  # -> out, A, B, pl, layerNames, names, archive, freeTag, export, PanelC41; inputs x: tree, y: tree, z: list of Polyline
# ---------- c_script: C# usings ----------
using Rhino.Geometry.Intersect;
using System.Linq;
using Rhino.DocObjects;
using Rhino.UI.Controls;
using Grasshopper.Kernel.Types.Transforms;
using System.Diagnostics;
using Rhino.UI;
using Rhino.Render.ChangeQueue;
# ---------- c_script: C# ----------
    facade = new Facade(x, y, z);

    panelC41s = new List<PanelC41>();
    plines = new DataTree<Polyline>();
    this.archive = new List<string>();
    this.names = new DataTree<string>();
    types = new DataTree<string>();
    toExport = new List<string> { "Type,Width,Heigh,Marca,Facciata" };
    normals = new List<Vector3d>();
    //DELETE
    borders = new List<Polyline>();

    foreach (Grid3d grid in facade.grids)
    {
      int i = facade.grids.IndexOf(grid);
      panelC41s.AddRange(grid.panels);
      plines.AddRange(grid.Plines(grid.panels), new GH_Path(i));
      this.names.AddRange(grid.NameTags(grid.panels), new GH_Path(i));
      types.AddRange(grid.TypeTags(grid.panels), new GH_Path(i));
      toExport.AddRange(grid.ToExport(grid.panels));
      normals.Add(grid.normal);

      borders.Add(grid.border);
    }
    this.archive.AddRange(ArchiveTypes(panelC41s));

    A = facade.grids[0].ax;
    B = facade.baseLines;
    pl = plines;
    layerNames = types;
    names = this.names;
    archive = this.archive;
    freeTag = facade.baseLine;
    export = toExport;
    PanelC41 = normals;
# ---------- c_script: C# additional code ----------
  // fields
  public Facade facade;
  public List<PanelC41> panelC41s;
  public DataTree<Polyline> plines;
  public DataTree<string> names;
  public DataTree<string> types;
  public List<string> toExport;
  public List<Vector3d> normals;

  public List<string> archive;

  //DELETE
  public List<Polyline> borders;

  public class Facade
  {
    //fields
    public List<Grid3d> grids;
    //public DataTree<PanelC41> panelsTree;
    public List<Point3d> points;
    public List<double> angles;
    public List<Polyline> baseLines;

    //DELETE
    public List<Polyline> baseLine; //?? a cosa serve avere in memoria una lista di polilinee unica?
    public List<Vector3d> vecs;
    //contructor
    public Facade(DataTree<object> input, DataTree<object> obs, List<Polyline> baseline)
    {
      grids = new List<Grid3d>();
      //panelsTree = new DataTree<PanelC41>();

      var counter = FacadeCount(input);
      var pointer = 0;

      //DELETE //Sostituisce funzione FillAngles() ma se messa prima del for loop rompe
      vecs = new List<Vector3d>();
      List<Polyline> bL = new List<Polyline>();
      foreach (Polyline p in baseline)
      {
        for (int i = 0; i < p.Count - 1; i++)
        {
          bL.Add(new Polyline(new List<Point3d> { p[i], p[i + 1] }));
        }
      }
      // END DELETE

      for (int i = 0; i < counter.Count; i++)
      {
        DataTree<object> tmp = new DataTree<object>();
        DataTree<object> tmpObs = new DataTree<object>();
        var count = 0;

        for (int j = pointer; j < pointer + counter[i]; j++)
        {
          tmp.AddRange(input.Branch(j), new GH_Path(count)); count++;
        }
        pointer += counter[i];

        var k = i * 4;
        count = 0;
        for (int j = k; j < k + 4; j++)
        {
          tmpObs.AddRange(obs.Branch(j), new GH_Path(count));
          count++;
        }
        vecs.Add(new Vector3d(bL[i][1] - bL[i][0]));
        Grid3d tmpGrid = new Grid3d(tmp, tmpObs, new Vector3d(bL[i][1] - bL[i][0]));
        grids.Add(tmpGrid);
        //panelsTree.AddRange(tmpGrid.panels, new GH_Path(i - 1));
      }

      FillAngles(baseline);

      for (int i = 0; i < grids.Count; i++)
      {
        PostPanels(grids[i]);
      }

      CorrectExport();
    }

    public List<int> FacadeCount(DataTree<object> input)
    {
      List<int> k = new List<int> { 1 };
      List<double> compare = new List<double>();

      for (int i = 0; i < input.BranchCount; i++)
      {
        double a = char.GetNumericValue(input.Branch(i)[0].ToString().Split('-')[1][0]);
        compare.Add(a);
      }

      for (int i = 1; i < compare.Count; i++)
      {
        if (compare[i] == compare[i - 1]) k[k.Count - 1]++;
        else k.Add(1);
      }

      return k;
    }

    public void FillAngles(List<Polyline> baseline)
    {
      baseLine = new List<Polyline>();
      baseLines = new List<Polyline>();
      angles = new List<double>();

      foreach (Polyline p in baseline)
      {
        baseLine.Add(new Polyline(p.Select(point => point).ToList()));
        angles.Add(2 * Math.PI);

        for (int i = 1; i < p.Count - 1; i++)
        {
          baseLines.Add(new Polyline(new List<Point3d> { p[i - 1], p[i] }));

          if (Intersection.CurveCurve(new Line(p[i - 1], p[i + 1]).ToNurbsCurve(),
            new Line(p[i], grids[i - 1].normal, 100000).ToNurbsCurve(), 0.1, 0.1).Count > 0)
          {
            angles.AddRange(Enumerable.Repeat(Vector3d.VectorAngle(new Vector3d(p[i - 1] - p[i]), new Vector3d(p[i + 1] - p[i])), 2));
          }
          else
          {
            angles.AddRange(Enumerable.Repeat(2 * Math.PI - Vector3d.VectorAngle(new Vector3d(p[i - 1] - p[i]), new Vector3d(p[i + 1] - p[i])), 2));
          }
        }
        baseLines.Add(new Polyline(new List<Point3d> { p[p.Count - 2], p[p.Count - 1] }));

        angles.Add(2 * Math.PI);
      }
    }

    public void PostPanels(Grid3d grid)
    {
      int fugaMax = 16;
      int[] a;
      if (baseLines[grids.IndexOf(grid)][1].X - baseLines[grids.IndexOf(grid)][0].X > 0) a = new int[] { 0, 1 };
      else a = new int[] { 1, 0 };

      for (int i = 0; i < grid.panels.Count; i++)
      {
        ////BOTTOM
        //if (Math.Abs(grid.panels[i].pl[0].Z - grid.border[0].Z) < fugaMax)
        //{
        //  grid.panels[i].type = "E";
        //}
        ////TOP
        //if (grid.height[0].Z - Math.Abs(grid.panels[i].pl[3].Z) < fugaMax)
        //{
        //  grid.panels[i].type = "E";
        //}

        //LEFT
        if (Math.Abs(grid.panels[i].pl[0].X - baseLines[grids.IndexOf(grid)][a[0]].X) < fugaMax && Math.Abs(grid.panels[i].pl[0].Y - baseLines[grids.IndexOf(grid)][a[0]].Y) < fugaMax)
        {
          if (grid.panels[i].type == "A*C") grid.panels[i].type = "C*" + BorderPanel(grids.IndexOf(grid), a[0]);
          else grid.panels[i].type = BorderPanel(grids.IndexOf(grid), a[0]);
        }
        //RIGHT
        if (Math.Abs(grid.panels[i].pl[1].X - baseLines[grids.IndexOf(grid)][a[1]].X) < fugaMax && Math.Abs(grid.panels[i].pl[1].Y - baseLines[grids.IndexOf(grid)][a[1]].Y) < fugaMax)
        {
          if (grid.panels[i].type == "A*C") grid.panels[i].type = "C*" + BorderPanel(grids.IndexOf(grid), a[1]);
          else grid.panels[i].type = BorderPanel(grids.IndexOf(grid), a[1]);
        }
      }
    }

    public string BorderPanel(int i, int a)
    {
      double angle = angles[(2 * i) + a];

      if (angle == 2 * Math.PI)
      {
        if (a == 0) return "E";
        else return "F";
      }
      // I and J Panels
      else if (grids[i].monopanel)
      {
        angle = (180 / Math.PI) * angle;
        angle = (360 - angle) / 2;
        if (a == 0) return "J" + "." + Math.Round(angle).ToString();
        else return "I" + "." + Math.Round(angle).ToString();
      }
      else
      {
        angle = (180 / Math.PI) * angle;
        angle = (360 - angle) / 2;
        if (a == 0) return "H" + "." + Math.Round(angle).ToString();
        else return "G" + "." + Math.Round(angle).ToString();
      }
    }

    public void CorrectExport()
    {
      foreach (Grid3d grid in grids)
      {
        int a = grids.IndexOf(grid);
        foreach (PanelC41 p in grid.panels)
        {
          p.toExcel = p.type + "," + p.width.ToString() + "," + p.height.ToString() +
        "," + p.type + "." + p.width.ToString() + "." + p.height.ToString() + "," + a.ToString();
        }
      }
    }
  }

  public class Grid3d
  {
    DataTree<object> param;
    public DataTree<Polyline> obs;

    public Polyline border;
    public Polyline height;
    public Vector3d normal;
    public Vector3d ax;

    // tutte le coordinate delle fughe in X e Z
    List<Point3d> pointCoordinates;
    List<double> zCoordinates;

    public List<PanelC41> panels;
    public List<Point3d> pts;

    // DELETE
    public bool monopanel;

    public Grid3d(DataTree<object> x, DataTree<object> y, Vector3d vector)
    {
      param = x;
      obs = new DataTree<Polyline>();
      ax = new Vector3d(vector);

      for (int i = 0; i < y.BranchCount; i++)
      { obs.AddRange(y.Branch(i).Select(pl => (PolylineCurve)pl).ToList().Select(pl => pl.ToPolyline()).ToList(), new GH_Path(i)); }

      BorderRotation(x.Branch(0)[1], vector);
      OrderLines(param);

      pts = new List<Point3d>();

      panels = Panels(pointCoordinates, zCoordinates);

      OrderOutput(panels);

      PostPanels(panels);
    }

    public void BorderRotation(object a, Vector3d vector)
    {
      PolylineCurve p = (PolylineCurve)a;
      Polyline tmpPl = p.ToPolyline();
      List<Point3d> list = tmpPl.Select(point => point).ToList();
      list.RemoveAt(list.Count - 1);
      list.OrderBy(point => point.Z).ThenBy(point => point.X);

      border = new Polyline(list.GetRange(0, 2));
      height = new Polyline(new List<Point3d> { list[3], list[0] });

      //normal = Vector3d.CrossProduct(new Vector3d(border[1] - border[0]), new Vector3d(height[0] - height[1]));
      normal = Vector3d.CrossProduct(vector, new Vector3d(height[0] - height[1]));
    }

    public void OrderLines(DataTree<object> param)
    {
      int verticalPanelCount = 0;

      List<double> xtmp = new List<double>();
      List<Point3d> ptmp = new List<Point3d>();
      List<double> ztmp = new List<double>();

      // i = 1 perché il primo è il bordo
      for (int i = 1; i < param.BranchCount; i++)
      {
        int fuga = (int)Convert.ToInt64(param.Branch(i)[0].ToString().Split('-')[2].ToString().Split('.')[0]);
        char dir = param.Branch(i)[0].ToString().Split('-')[1][1];

        List<Point3d> tmpP = new List<Point3d>();

        if (dir == 'h')
        {
          // start at j = 1 perchè la prima linea è il nome del layer 
          for (int j = 1; j < param.Branch(i).Count; j++)
          {
            PolylineCurve tmpPl = (PolylineCurve)param.Branch(i)[j];
            ztmp.Add(tmpPl.PointAt(0).Z - fuga);
            ztmp.Add(tmpPl.PointAt(0).Z + fuga);
          }
        }

        else if (dir == 'v')
        {
          verticalPanelCount += param.Branch(i).Count;
          // start at j = 1 perchè la prima linea è il nome del layer
          for (int j = 1; j < param.Branch(i).Count; j++)
          {
            PolylineCurve tmpPl = (PolylineCurve)param.Branch(i)[j];
            Point3d tmpPoint = tmpPl.PointAtStart;
            Point3d tp = new Point3d(tmpPl.PointAt(0).X, tmpPl.PointAt(0).Y, border.PointAt(0).Z);
            Circle c = new Circle(tp, fuga);
            var events = Intersection.CurveCurve(border.ToNurbsCurve(), c.ToNurbsCurve(), 0.1, 0.1);
            foreach (IntersectionEvent ie in events) { tmpP.Add(new Point3d(ie.PointA)); }
          }

          ptmp.AddRange(tmpP);
        }
      }

      ztmp.Sort();
      ztmp.RemoveAt(0);
      ztmp.RemoveAt(0);
      ztmp.RemoveAt(ztmp.Count - 1);
      ztmp.RemoveAt(ztmp.Count - 1);
      double[] t = new double[] { height[0].Z, height[1].Z };
      ztmp.Insert(0, t.Min());
      ztmp.Add(t.Max());

      if (Math.Abs(border[1].X - border[0].X) > 0.01)
      {
        ptmp = ptmp.OrderBy(point => point.X).ToList();
        ptmp.RemoveAt(0);
        ptmp.RemoveAt(ptmp.Count - 1);
        ptmp.AddRange(new List<Point3d> { border.PointAt(0), border.PointAt(1) });

        pointCoordinates = ptmp.OrderBy(point => point.X).ToList();
      }
      else
      {
        ptmp = ptmp.OrderBy(point => point.Y).ToList();
        ptmp.RemoveAt(0);
        ptmp.RemoveAt(ptmp.Count - 1);
        ptmp.AddRange(new List<Point3d> { border.PointAt(0), border.PointAt(1) });

        pointCoordinates = ptmp.OrderBy(point => point.Y).ToList();
      }

      zCoordinates = ztmp;

      if (verticalPanelCount > 2) monopanel = false;
      else monopanel = true;
    }

    public List<PanelC41> Panels(List<Point3d> pointCoordinates, List<double> zCoordinates)
    {
      List<PanelC41> panels = new List<PanelC41>();

      for (int i = 0; i < zCoordinates.Count; i += 2)
      {
        for (int j = 0; j < pointCoordinates.Count; j += 2)
        {
          var points = new List<Point3d> {
                new Point3d(pointCoordinates[j].X, pointCoordinates[j].Y, zCoordinates[i]),
                new Point3d(pointCoordinates[j + 1].X, pointCoordinates[j + 1].Y, zCoordinates[i]),
                new Point3d(pointCoordinates[j + 1].X, pointCoordinates[j + 1].Y, zCoordinates[i + 1]),
                new Point3d(pointCoordinates[j].X, pointCoordinates[j].Y, zCoordinates[i + 1]),
                new Point3d(pointCoordinates[j].X, pointCoordinates[j].Y, zCoordinates[i])
            };

          pts.AddRange(points.GetRange(0, 4));

          PanelC41 tmpPanel = new PanelC41(points, obs, ax);
          if (!tmpPanel.crossed) panels.Add(tmpPanel);
        }
      }

      return panels;
    }

    public void OrderOutput(List<PanelC41> panels)
    {
      List<PanelC41> tmp;
      if (Math.Abs(border[1].X - border[0].X) > 0.01)
      {
        tmp = panels.OrderBy(a => a.firstCorner[0]).ThenBy(b => b.firstCorner[2]).ToList();
      }
      else
      {
        tmp = panels.OrderBy(a => a.firstCorner[1]).ThenBy(b => b.firstCorner[2]).ToList();
      }
      this.panels.Clear();

      this.panels.AddRange(tmp);
    }

    void PostPanels(List<PanelC41> panels)
    {
      for (int i = 0; i < panels.Count - 1; i++)
      {
        if (panels[i].type == "B" || panels[i].type == "B*C")
        {
          if (panels[i + 1].type == "C" || panels[i + 1].type == "A*C") panels[i + 1].type = "D*C";
          else panels[i + 1].type = "D";
        }
      }
    }

    public List<Polyline> Plines(List<PanelC41> panels)
    {
      List<Polyline> polylines = panels.Select(i => i.pl).ToList();

      return polylines;
    }

    public List<bool> FreeTag(List<PanelC41> panels)
    {
      List<bool> freeTag = panels.Select(i => i.crossed).ToList();

      return freeTag;
    }

    public List<string> DimensionsTags(List<PanelC41> panels)
    {
      List<string> nameTags = panels.Select(i => i.name).ToList();

      return nameTags;
    }

    public List<string> NameTags(List<PanelC41> panels)
    {
      List<string> names = panels.Select(i => i.type).ToList();
      for (int i = 0; i < panels.Count; i++)
      {
        names[i] = names[i] + "|" + panels[i].name;
      }

      return names;
    }

    public List<string> TypeTags(List<PanelC41> panels)
    {
      //List<string> types = panels.Select(i => i.type).ToList();
      List<string> types = panels.Select(i => i.type.Split('.')[0]).ToList();

      return types;
    }

    public List<string> ToExport(List<PanelC41> panels)
    {
      List<string> export = panels.Select(i => i.toExcel).ToList();
      //export.Insert(0, "Type,Width,Heigh,Marca");

      return export;
    }

  }

  public class PanelC41
  {
    //fields
    public double width;
    public double height;
    public double borderUp;
    public double borderDown;
    public double hookUp;
    public double hookDown;

    public Polyline pl;
    public bool crossed;
    public string type;
    public string name;
    public double[] firstCorner = new double[3];
    public Vector3d ax;

    public string toExcel;

    //Constructor
    public PanelC41(List<Point3d> list, DataTree<Polyline> obs, Vector3d axes)
    {
      borderUp = 1;
      borderDown = 2;
      hookUp = 3;
      hookDown = 4;
      type = "A";

      crossed = false;

      pl = new Polyline(list);
      firstCorner[0] = pl[0].X;
      firstCorner[1] = pl[0].Y;
      firstCorner[2] = pl[0].Z;

      ax = new Vector3d(axes);

      int[] i = Intercept(obs);

      if (i[0] >= 0)
      {
        crossed = InterceptedPanelVertical(obs.Branch(0), i[0], 8);
      }
      if (i[1] >= 0)
      {
        crossed = InterceptedPanelHorizontal(obs.Branch(2), i[1], 8);
      }

      Name();
      Detached(obs.Branch(1));
      InterceptedPanelVarious(obs.Branch(3));

      toExcel = type + "," + width.ToString() + "," + height.ToString() +
        "," + type + "." + width.ToString() + "." + height.ToString();
    }

    public PanelC41(List<Point3d> list)
    {
      borderUp = 1;
      borderDown = 2;
      hookUp = 3;
      hookDown = 4;
      type = "A";

      crossed = false;

      pl = new Polyline(list);
      firstCorner[0] = pl[0].X;
      firstCorner[1] = pl[0].Y;

      Name();

      toExcel = type + "," + width.ToString() + "," + height.ToString() +
        "," + type + "." + width.ToString() + "." + height.ToString();
    }

    public int[] Intercept(DataTree<Polyline> obs)
    {
      // ora non funziona per ostacoli multipli che intersecano oggetti
      int b = -1;
      int c = -1;

      // Branch(0) windows. Polylines centrate sul pannello verticalmente
      for (int i = 0; i < obs.Branch(0).Count; i++)
      {
        var tmp = Intersection.CurveCurve(pl.ToPolylineCurve(), obs.Branch(0)[i].ToPolylineCurve(), 0.1, 0.1).Count;
        //counter += tmp;
        if (tmp != 0) b = i;
      }

      // Branch(2) pavements. Polylines centrate sul pannello orizzontalmente
      for (int i = 0; i < obs.Branch(2).Count; i++)
      {
        var tmp = Intersection.CurveCurve(pl.ToPolylineCurve(), obs.Branch(2)[i].ToPolylineCurve(), 0.1, 0.1).Count;
        //counter += tmp;
        if (tmp != 0) c = i;
      }

      if (b < 0 && c < 0) crossed = false;
      else crossed = true;
      return new int[] { b, c };
    }

    public void Name()
    {
      width = Math.Round(pl[0].DistanceTo(pl[1]));
      height = Math.Round(pl[1].DistanceTo(pl[2]));
      name = width.ToString() + '-' + height.ToString();
    }

    public bool InterceptedPanelVertical(List<Polyline> obs, int i, double fuga)
    {
      // Funziona solo per finestre centrate sui pannelli
      // Viene considerata solo la Z quindi

      double[] zObs = new double[] { obs[i][0].Z, obs[i][1].Z, obs[i][2].Z };
      double[] z = new double[] { pl[0].Z, pl[1].Z, pl[2].Z };

      if (zObs.Max() >= z.Max() && zObs.Min() <= z.Min())
      {
        return true;
      }
      else if (z.Max() > zObs.Max())
      {
        double newZ = zObs.Max();
        List<Point3d> tmp = new List<Point3d>()
        {
          new Point3d(pl[0].X, pl[0].Y, newZ+ fuga),
          new Point3d(pl[1].X, pl[1].Y, newZ+ fuga),
          new Point3d(pl[2]),
          new Point3d(pl[3]),
          new Point3d(pl[4].X, pl[4].Y, newZ+ fuga),
        };

        pl = new Polyline(tmp);
        return false;
      }
      else if (z.Min() < zObs.Min())
      {
        double newZ = zObs.Min();
        List<Point3d> tmp = new List<Point3d>()
        {
          new Point3d(pl[0]),
          new Point3d(pl[1]),
          new Point3d(pl[2].X, pl[2].Y, newZ - fuga),
          new Point3d(pl[3].X, pl[3].Y, newZ - fuga),
          new Point3d(pl[4]),
        };

        pl = new Polyline(tmp);

        return false;
      }

      else { return false; }
    }

    public bool InterceptedPanelHorizontal(List<Polyline> obs, int i, double fuga)
    {
      // Funziona solo per rettangoli orizzontali centrati sui pannelli
      // Viene considerata solo X-Y quindi

      List<Point3d> p = new List<Point3d> { pl[0], pl[1] };
      List<Point3d> pObs = new List<Point3d> { obs[i][0], obs[i][1], obs[i][2], obs[i][3] };
      pObs.OrderBy(point => point.Z);
      pObs.RemoveRange(2, 2);

      double[] compare = new double[4];

      if (Math.Abs(pl[1].X - pl[0].X) > 0.01)
      {
        pObs = pObs.OrderBy(point => point.X).ToList();
        compare = new double[] { pl[0].X, pl[1].X, pObs[0].X, pObs[1].X };
      }
      else
      {
        pObs = pObs.OrderBy(point => point.Y).ToList();
        compare = new double[] { pl[0].Y, pl[1].Y, pObs[0].Y, pObs[1].Y };
      }

      // Obs bigger
      if (compare[3] >= compare[1] && compare[2] <= compare[0])
      {
        return true;
      }

      // Obs one side 
      else if (compare[1] > compare[3])
      {
        List<Point3d> tmp = new List<Point3d>()
        {
          new Point3d(pObs[1].X, pObs[1].Y, pl[0].Z),
          new Point3d(p[1].X , p[1].Y, pl[1].Z),
          new Point3d(p[1].X , p[1].Y, pl[2].Z),
          new Point3d(pObs[1].X, pObs[1].Y, pl[3].Z),
          new Point3d(pObs[1].X, pObs[1].Y, pl[4].Z)
        };

        pl = new Polyline(tmp);

        if (ax.X < 0 || ax.Y < 0) type = "F";
        else type = "E";

        return false;
      }

      // Obs other side
      else if (compare[0] < compare[2])
      {
        List<Point3d> tmp = new List<Point3d>()
        {
          new Point3d(p[0]),
          new Point3d(pObs[0].X, pObs[0].Y, pl[1].Z),
          new Point3d(pObs[0].X, pObs[0].Y, pl[2].Z),
          new Point3d(pl[3]),
          new Point3d(p[0])
        };

        pl = new Polyline(tmp);

        if (ax.X < 0 || ax.Y < 0) type = "E";
        else type = "F";

        return false;
      }

      else { return false; }
    }


    //public bool InterceptedPanelHorizontal(List<Polyline> obs, int i, double fuga)
    //{
    //  // Funziona solo per rettangoli orizzontali centrati sui pannelli
    //  // Viene considerata solo X-Y quindi

    //  List<Point3d> p = new List<Point3d> { pl[0], pl[1] };
    //  List<Point3d> pObs = new List<Point3d> { obs[i][0], obs[i][1], obs[i][2], obs[i][3] };
    //  pObs.OrderBy(point => point.Z);
    //  pObs.RemoveRange(2, 2);

    //  double[] compare = new double[4];

    //  double t0 = pl[1].X - pl[0].X;
    //  double t1 = pObs[1].X - pObs[0].X;
    //  bool sameSignX = SameSign(t0, t1);

    //  double t2 = pl[1].Y - pl[0].Y;
    //  double t3 = pObs[1].Y - pObs[0].Y;
    //  bool sameSignY = SameSign(t2, t3);

    //  if (Math.Abs(pl[1].X - pl[0].X) > 0.01)
    //  {
    //    if (!sameSignX)
    //    {
    //      pObs = pObs.OrderBy(point => point.X).ToList();
    //    }
    //    compare = new double[] { pl[0].X, pl[1].X, pObs[0].X, pObs[1].X };
    //  }
    //  else
    //  {
    //    if (!sameSignY)
    //    {
    //      pObs = pObs.OrderBy(point => point.Y).ToList();
    //    }
    //    compare = new double[] { pl[0].Y, pl[1].Y, pObs[0].Y, pObs[1].Y };
    //    //p.OrderBy(point => point.Y);
    //    //pObs.OrderBy(point => point.Y);
    //    //compare = new double[] { pl[0].Y, pl[1].Y, pObs[0].Y, pObs[1].Y };
    //  }

    //  // Obs bigger
    //  if (compare[3] >= compare[1] && compare[2] <= compare[0])
    //  {
    //    return true;
    //  }

    //  // Obs one side 
    //  else if (compare[1] > compare[3])
    //  {
    //    List<Point3d> tmp = new List<Point3d>()
    //    {
    //      new Point3d(pObs[1].X, pObs[1].Y, pl[0].Z),
    //      new Point3d(p[1].X , p[1].Y, pl[1].Z),
    //      new Point3d(p[1].X , p[1].Y, pl[2].Z),
    //      new Point3d(pObs[1].X, pObs[1].Y, pl[3].Z),
    //      new Point3d(pObs[1].X, pObs[1].Y, pl[4].Z)
    //    };

    //    pl = new Polyline(tmp);

    //    if (!sameSignX | !sameSignY) type = "F";
    //    else type = "E";

    //    return false;
    //  }

    //  // Obs one side
    //  else if (compare[0] < compare[2])
    //  {
    //    List<Point3d> tmp = new List<Point3d>()
    //    {
    //      new Point3d(p[0]),
    //      new Point3d(pObs[0].X, pObs[0].Y, pl[1].Z),
    //      new Point3d(pObs[0].X, pObs[0].Y, pl[2].Z),
    //      new Point3d(pl[3]),
    //      new Point3d(p[0])
    //    };

    //    pl = new Polyline(tmp);

    //    if (!sameSignX | !sameSignY) type = "E";
    //    else type = "F";

    //    return false;
    //  }

    //  else { return false; }
    //}

    public void InterceptedPanelVarious(List<Polyline> obs)
    {
      int counter = 0;
      double yAxe = Math.Abs(pl[1].X - pl[0].X);
      double[] h;

      if (yAxe > 0.01)
      {
        h = new double[] { pl[0].X, pl[1].X };
      }
      else
      {
        h = new double[] { pl[0].Y, pl[1].Y };
      }

      double[] z = new double[] { pl[1].Z, pl[2].Z };

      for (int i = 0; i < obs.Count; i++)
      {
        // Pannelli intersecati da un ostacolo
        var tmp = Intersection.CurveCurve(pl.ToPolylineCurve(), obs[i].ToPolylineCurve(), 0.1, 0.1).Count;
        counter += tmp;
        double[] hObs;
        if (yAxe > 0.01)
        {
          hObs = new double[] { obs[i][0].X, obs[i][1].X };
        }
        else
        {
          hObs = new double[] { obs[i][0].Y, obs[i][1].Y };
        }

        double[] zObs = new double[] { obs[i][1].Z, obs[i][2].Z };

        // Pannelli C circondati // positive or negative for when the x or y swithcs to the negative side
        bool positive = hObs[1] > h[1] && h[0] > hObs[0] && zObs[1] > z[1] && z[0] > zObs[0];
        bool negative = h[0] > hObs[1] && hObs[0] > h[1] && zObs[1] > z[1] && z[0] > zObs[0];
        if (positive | negative)
        {
          counter++;
          crossed = true;
        }

        // Pannelli C con un foro
        if (hObs[1] < h[1] && h[0] < hObs[0] && zObs[1] < z[1] && z[0] < zObs[0]) counter++;

      }

      if (counter > 0)
      {
        //if (type == "A") type = "C";
        /*else*/
        type += "*C";
      }
    }

    public void Detached(List<Polyline> det)
    {
      // Per ogni Line di intersezione 

      int counter = 0;

      for (int i = 0; i < det.Count; i++)
      {
        var tmp = Intersection.CurveCurve(pl.ToPolylineCurve(), det[i].ToPolylineCurve(), 0.1, 0.1).Count;
        counter += tmp;
      }

      if (counter != 0)
      {
        type = "B";
      }
    }

    public bool SameSign(double num1, double num2)
    {
      return num1 >= 0 && num2 >= 0 || num1 < 0 && num2 < 0;
    }
  }

  public List<string> ArchiveDimensions(List<PanelC41> panelC41s)
  {
    List<string> list;
    var orderedPanels = panelC41s.OrderBy(panelC41 => panelC41.width).ThenBy(panelC41 => panelC41.height);

    list = orderedPanels.Select(x => x.name).ToList();

    List<string> arc = new List<string> { list[0] };
    for (int i = 1; i < list.Count; i++)
    {
      if (list[i] != list[i - 1])
      {
        arc.Add(list[i]);
      }
    }

    return arc;
  }

  public List<string> ArchiveTypes(List<PanelC41> panelC41s)
  {
    List<string> list;
    var orderedPanels = panelC41s.OrderBy(panelC41 => panelC41.type);

    list = orderedPanels.Select(x => x.type.Split('.')[0]).ToList();

    List<string> arc = new List<string> { list[0] };
    for (int i = 1; i < list.Count; i++)
    {
      if (list[i] != list[i - 1])
      {
        arc.Add(list[i]);
      }
    }

    return arc;
  }
# ---------- end c_script ----------
scriptpar = ScriptParasite(Enable=True, Folder="C:\Users\riccardo\source\repos\GH_Develop\AutoPanel")

# ---- group: PRODUCTION CHECK
c_script_2 = CSharpScript(x=c_script.pl, y=c_script.names)  # -> A; inputs x: list of Polyline, y: list of String
# ---------- c_script_2: C# usings ----------
using System.Linq;
# ---------- c_script_2: C# ----------
    alert.Clear();

    if (x.Count == y.Count)
    {
      for (int i = 0; i < x.Count; i++)
      {
        Check(x[i], y[i]);
      }
    }

    A = alert;
# ---------- c_script_2: C# additional code ----------
  // START CODE

  List<Point3d> alert = new List<Point3d>();

  public void Check(Polyline pl, string name)
  {
    string type = name.Split('|')[0];
    double len;
    double tolerance;

    if (type == "A")
    {
      tolerance = 90;
      len = pl[0].DistanceTo(pl[1]);
      double test = len + tolerance;

      if (test > 1251)
      {
        alert.Add(new Point3d(pl.BoundingBox.Center));
      }
    }
  }

  // END CODE
# ---------- end c_script_2 ----------
scriptpar_2 = ScriptParasite(Enable=True, Folder="C:\Users\riccardo\source\repos\GH_Develop\AutoPanel")

# ---- group: PRODUCTION
cir = Circle(Plane=c_script_2, Radius=100)

# ----
bake = BooleanToggle(False)
python_2 = GhPythonScript(x=f_ghfilepath.FilePath)  # -> a
# ---------- python_2: Python ----------
__author__ = "riccardo"
__version__ = "2023.03.06"

import rhinoscriptsyntax as rs

a = x + 'exp'
# ---------- end python_2 ----------

bake_hatch_colors = Button()
bake_hatch_grey = Button()
panel_7 = Panel("BAKING STATION")
bake_polylines = Button()
bake_texts = Button()

# ---- group: XLS
xlsx = Button()
f_ghfilepath_2 = GHFilePathInfo()  # -> F, P
# ---------- f_ghfilepath_2: C# ----------
                                      /*
    froGH - a sparse collection of (in)utilities for Grasshopper

    GH File and Path info

    code by Alessio Erioli

    froGH by Co-de-iT is licensed under a Creative Commons Attribution 4.0 International License.
    http://creativecommons.org/licenses/by/4.0/

    */

    initComp();

    GH_Document ghDoc = Grasshopper.Instances.ActiveCanvas.Document;

    int nameLen = ghDoc.DisplayName.TrimEnd('*').Length + 3; // +3 accounts for the '.gh' extension
    int fileLen = ghDoc.FilePath.TrimEnd('*').Length;

    F = ghDoc.DisplayName.TrimEnd('*');
    P = ghDoc.FilePath.Substring(0, fileLen - nameLen);
# ---------- f_ghfilepath_2: C# additional code ----------
  void initComp(){

    Component.Name = "GH File Path Info";
    Component.NickName = "f_GHFilePath";
    Component.Description = "Provides info on current Grasshopper Document file name and path\nUseful for exporting files with the same name as the gh file and in the same directory";
    Component.Params.Output[0].Name = "File Name";
    Component.Params.Output[0].Description = "Current GH file name";
    Component.Params.Output[1].Name = "File Path";
    Component.Params.Output[1].Description = "Current GH file path";
  }
# ---------- end f_ghfilepath_2 ----------
python_3 = GhPythonScript(x=f_ghfilepath_2.P, y=c_script.export, z=xlsx)  # -> a; inputs y: list, z: Boolean
# ---------- python_3: Python ----------
__author__ = "riccardo"
__version__ = "2023.02.23"

import os
import rhinoscriptsyntax as rs

def Database():
    # Get Path in the document
    filePathXlsx = os.path.join(x, 'database' + '.xlsx')
    
    txt = ''
    
    for i in y:
        txt += i
        txt += '\n'
    
    #Write to .xlsx
    file = open(filePathXlsx, "w")
    file.write(txt[0:len(txt)-1])
    file.close()
    
    return txt

if (z):
    a = Database()
# ---------- end python_3 ----------

# ---- group: VIEW
toggle = BooleanToggle(True)

# ---- group: ACTIVATE BAKING
toggle_2 = BooleanToggle(False)

# ---- group: WIRE DISPLAY
list = ValueList({"def": 0, "fai": 1, "hid": 2}, selected="hid")

# ----
wiredisplay = ControlWireDisplay(WireDisplay=list)
hideshow = HideShowObjectPreview(Visible=toggle, AllObjects_Object=[preview, textbaker_2, cir])
onoff = EnableDisableObject(Enabled=toggle_2, AllObjects_Object=[qb, textbaker, layers, cluster, cluster_3])

area = Area(Geometry=c_script.pl)  # -> Area, Centroid
pl = PlaneNormal(Origin=area.Centroid, ZAxis=graft(c_script.PanelC41))
python_4 = GhPythonScript(x=pl)  # -> simplify(a), b; inputs x: Plane
# ---------- python_4: Python ----------
__author__ = "riccardo"
__version__ = "2023.03.01"

import rhinoscriptsyntax as rs
import math

if (x.YAxis.Z < 0):
    x.Rotate(math.pi, x.ZAxis, x.Origin)
    a = x

else:
    a = x

b = x.ZAxis
# ---------- end python_4 ----------

# ---- group: AUTOMATIC BAKE
c_script_3 = CSharpScript(
    bake=bake,
    plines=c_script.pl,
    layerNames=c_script.layerNames,
    names=c_script.names,
    textLocations=python_4.a,
    savingPath=python_2,
    baseLines=c_script.B,
    pl=c_script.pl)  # -> out, A; inputs bake: Boolean, plines: tree of GeometryBase, layerNames: tree of String, names: tree of String, textLocations: tree of Plane, savingPath: String, baseLines: list of Polyline, pl: tree of Polyline
# ---------- c_script_3: C# usings ----------
using Rhino.Commands;
using Rhino.Display;
using System.Drawing;
using Rhino.DocObjects;
# ---------- c_script_3: C# ----------
    RhinoDoc doc = RhinoDoc.ActiveDoc;

    // TEXT ATTRIBUTE
    ObjectAttributes textAttribute = new ObjectAttributes();
    textAttribute.LayerIndex = doc.Layers.FindName("text").Index;

    // GREY HATCH ATTRIBUTE
    ObjectAttributes greyHatchesAtt = new ObjectAttributes();
    greyHatchesAtt.LayerIndex = doc.Layers.FindName("hatch_grey").Index;
    Color colorGray = Color.Gray;
    greyHatchesAtt.ObjectColor = colorGray;
    greyHatchesAtt.ColorSource = ObjectColorSource.ColorFromObject;

    if (bake)
    {
      ConstructionPlane cpOrigin = doc.Views.ActiveView.ActiveViewport.GetConstructionPlane();

      for (int i = 0; i < plines.BranchCount; i++)
      {
        ConstructionPlane cp = new ConstructionPlane();
        Plane p = new Plane(baseLines[i][0], new Vector3d(baseLines[i][1] - baseLines[i][0]), new Vector3d(0, 0, 1));

        cp.Plane = p;

        Transform cb = Transform.PlaneToPlane(cp.Plane, cpOrigin.Plane);
        //doc.Views.ActiveView.ActiveViewport.SetConstructionPlane(cp);

        for (int j = 0; j < plines.Branch(i).Count; j++)
        {
          ObjectAttributes colorHatchesAtt = new ObjectAttributes();
          colorHatchesAtt.LayerIndex = doc.Layers.FindName("hatch_colors").Index;
          int[] tmp = ColorRB(layerNames.Branch(i)[j]);
          Color color = Color.FromArgb(tmp[0], tmp[1], tmp[2]);
          colorHatchesAtt.ObjectColor = color;
          colorHatchesAtt.ColorSource = ObjectColorSource.ColorFromObject;

          ObjectAttributes plineAtt = new ObjectAttributes();
          plineAtt.LayerIndex = doc.Layers.FindName(layerNames.Branch(i)[j]).Index;

          TextEntity t = new TextEntity
          {
            PlainText = names.Branch(i)[j],
            Plane = textLocations.Branch(i)[j]
          };

          var a = plines.Branch(i)[j]; a.Transform(cb);
          var b = t; b.Transform(cb);
          //var c = hatches.Branch(i)[j]; c.Transform(cb);
          //var d = hatches.Branch(i)[j]; d.Transform(cb);

          var aa = pl.Branch(i)[j].ToPolylineCurve(); aa.Transform(cb);

          Hatch h = Hatch.Create(aa, 0, 0.0, 0.0, 0.0)[0];

          RhinoDocument.Objects.Add(/*plines.Branch(i)[j]*/a, plineAtt);
          RhinoDocument.Objects.Add(/*t*/b, textAttribute);
          RhinoDocument.Objects.Add(/*hatches.Branch(i)[j]*/h, greyHatchesAtt);
          RhinoDocument.Objects.Add(/*hatches.Branch(i)[j]*/h, colorHatchesAtt);
        }

        RhinoApp.RunScript("-SelAll", false);
        string path = savingPath + "/" + i.ToString() + ".dwg";

        RhinoApp.RunScript("-Export " + path + " " + "Enter ", false);
        RhinoApp.RunScript("-SelAll", false);
        RhinoApp.RunScript("-Delete", false);
      }
    }
# ---------- c_script_3: C# additional code ----------
  public int[] ColorRB(string layerName)
  {
    int[] k;

    if (layerName == "A")
    {
      k = new int[] { 242, 68, 68, 255 };
      return k;
    }
    else if (layerName == "B")
    {
      k = new int[] { 82, 137, 227, 255 };
      return k;
    }
    else if (layerName == "D")
    {
      k = new int[] { 150, 92, 250, 255 };
      return k;
    }
    else if (layerName == "E")
    {
      k = new int[] { 77, 200, 219, 255 };
      return k;
    }
    else if (layerName == "F")
    {
      k = new int[] { 174, 233, 242, 255 };
      return k;
    }
    else if (layerName == "G")
    {
      k = new int[] { 52, 140, 153, 255 };
      return k;
    }
    else if (layerName == "H")
    {
      k = new int[] { 10, 169, 194, 255 };
      return k;
    }
    else
    {
      k = new int[] { 227, 208, 61, 255 };
      return k;
    }
  }
# ---------- end c_script_3 ----------
# Prima di attivare:
# >activate baking:
# 
# >controllare sblocco layer:
#         >text
#         >hatch_grey
#         >hatch_colors
#         >pannelli
# 
# >bloccare altri layer
scriptpar_3 = ScriptParasite(Enable=True, Folder="C:\Users\riccardo\source\repos\GH_Develop\AutoPanel")

# ---- group: POLYLINES
python_5 = GhPythonScript(x=c_script.layerNames)  # -> a
# ---------- python_5: Python ----------
__author__ = "riccardo"
__version__ = "2023.02.21"

import rhinoscriptsyntax as rs

a = '%' + x
# ---------- end python_5 ----------
qb = QuickBaker(Geometric=c_script.pl, Attribute=python_5, Bake=bake_polylines)  # disabled

# ---- group: LAYERS
python_6 = GhPythonScript(x=c_script.archive)  # -> a; inputs x: list
# ---------- python_6: Python ----------
__author__ = "riccardo"
__version__ = "2023.02.24"

import rhinoscriptsyntax as rs

#x.append('hatch_grey')
#x.append('hatch_colors')

a = x
# ---------- end python_6 ----------
layers = CreateModifyLayers(LayerName=python_6, DeleteLayer=False, enableFullPath=False)  # -> LayerNames, LayerFullPath; disabled

# ---- group: HATCH GREY
cluster = Cluster_2(B=bake_hatch_grey, C=c_script.pl)  # -> ho, att; disabled

# ---- group: TEXT-BAKE
textbaker = TextBaker(
    Location=python_4.a,
    Text=c_script.names,
    Size="100",
    Attribute="%text",
    Justification=4,
    Bake=bake_texts,
    Dot_Text=False,
    Enable_Mask=True,
    On_Screen=False)  # disabled

# ---- group: OBSTACLE COLORS
cluster_2 = Cluster(x=c_script.freeTag)
preview = CustomPreview(Geometry=c_script.pl, Material=cluster_2)

# ---- group: TEXT-DISPLAY
textbaker_2 = TextBaker(
    Location=python_4.a,
    Text=c_script.names,
    Size="100",
    Justification=4,
    Bake=False,
    Dot_Text=False,
    Enable_Mask=True,
    On_Screen=False)

# ----
wiredisplay_2 = ControlWireDisplay(WireDisplay=2, AllObjects_Object=python_2)

# ---- group: HATCH COLORS
_11 = ColourSwatch(SwatchColor=RGB(174, 233, 242))
_10 = ColourSwatch(SwatchColor=RGB(77, 200, 219))
_12 = ColourSwatch(SwatchColor=RGB(52, 140, 153))
_13 = ColourSwatch(SwatchColor=RGB(10, 169, 194))
_0 = ColourSwatch(SwatchColor=RGB(242, 68, 68))
_1 = ColourSwatch(SwatchColor=RGB(227, 208, 61))
_2 = ColourSwatch(SwatchColor=RGB(82, 137, 227))
_3 = ColourSwatch(SwatchColor=RGB(227, 208, 61))
_4 = ColourSwatch(SwatchColor=RGB(227, 208, 61))
_5 = ColourSwatch(SwatchColor=RGB(227, 208, 61))
_6 = ColourSwatch(SwatchColor=RGB(227, 208, 61))
_7 = ColourSwatch(SwatchColor=RGB(227, 208, 61))
_8 = ColourSwatch(SwatchColor=RGB(150, 92, 250))
_9 = ColourSwatch(SwatchColor=RGB(227, 208, 61))
python_7 = GhPythonScript(x=c_script.layerNames)  # -> graft(a); inputs x: list
# ---------- python_7: Python ----------
__author__ = "riccardo"
__version__ = "2023.02.24"

import rhinoscriptsyntax as rs

list = []

for i in x:
    if (i == 'A'):
        list.append(0)
    if (i == 'A*C'):
        list.append(1)
    if (i == 'B'):
        list.append(2)
    if (i == 'B*C'):
        list.append(3)
    if (i == 'C*E'):
        list.append(4)
    if (i == 'C*F'):
        list.append(5)
    if (i == 'C*G'):
        list.append(6)
    if (i == 'C*H'):
        list.append(7)
    if (i == 'D'):
        list.append(8)
    if (i == 'D*C'):
        list.append(9)
    if (i == 'E'):
        list.append(10)
    if (i == 'F'):
        list.append(11)
    if (i == 'G'):
        list.append(12)
    if (i == 'H'):
        list.append(13)
    if (i == 'I'):
        list.append(14)
    if (i == 'J'):
        list.append(15)

a = list
# ---------- end python_7 ----------
panel_8 = Panel(c_script.archive)

cluster_3 = Cluster_3(
    B=bake_hatch_colors,
    C=c_script.pl,
    P=python_7,
    _0=_0,
    _1=_1,
    _2=_2,
    _3=_3,
    _4=_4,
    _5=_5,
    _6=_6,
    _7=_7,
    _8=_8,
    _9=_9,
    _10=_10,
    _11=_11,
    _12=_12,
    _13=_13)  # disabled

# ==== cluster Cluster
x = ClusterInput()
python = GhPythonScript(x=x)  # -> a
# ---------- python: Python ----------
__author__ = "riccardo"
__version__ = "2023.02.21"

import rhinoscriptsyntax as rs

if (x == False):
    a = '63,232,232'
else:
    a = '230,37,232'
# ---------- end python ----------
material = CreateMaterial(Diffuse=python, Specular=RGB(255, 255, 255), Emission=RGB(0, 0, 0), Transparency=0, Shine=0)
M = ClusterOutput(material)

# ==== cluster Counter
button = Button()
button_2 = Button()
_0 = Button()
c_script = CSharpScript(x=button, y=button_2, z=_0, u=Slider(581, range=0..1000))  # -> A; inputs x: Boolean, y: Boolean, z: Boolean, u: Int32
# ---------- c_script: C# ----------
        if(x) a++;
    if(y) a--;
    if (z) a = 0;

    A = a+u;
# ---------- c_script: C# additional code ----------
  int a = 0;
# ---------- end c_script ----------
panel = Panel(c_script)
item = ListItem(Index=c_script, Wrap=True)

# ==== cluster Cluster_2
B = ClusterInput()
C = ClusterInput()
createatts = CreateAttributes(LayerName="hatch_grey", Color=ColourSwatch(SwatchColor=RGB(181, 181, 181)), enableFullPath=False)
createhatch = CreateHatch(Bake=B, Curves=C, HatchPatternName="Solid", HatchScale=1, HatchRotation=0)  # -> HatchGeometry, HatchObjects
createhatch_2 = CreateHatch(Bake=B, Curves=C, HatchPatternName="Solid", HatchScale=1, HatchRotation=0, Attributes=createatts)  # -> HatchGeometry, HatchObjects
ho = ClusterOutput(createhatch.HatchObjects)
att = ClusterOutput(createatts)

# ==== cluster Cluster_3
_13 = ClusterInput()
P = ClusterInput()
_0 = ClusterInput()
_1 = ClusterInput()
_2 = ClusterInput()
_3 = ClusterInput()
_4 = ClusterInput()
_5 = ClusterInput()
_6 = ClusterInput()
_7 = ClusterInput()
_8 = ClusterInput()
_9 = ClusterInput()
_10 = ClusterInput()
_11 = ClusterInput()
_12 = ClusterInput()
weave = Weave(
    Pattern=P,
    Stream0=_0,
    Stream1=_1,
    Stream2=_2,
    Stream3=_3,
    Stream4=_4,
    Stream5=_5,
    Stream6=_6,
    Stream7=_7,
    Stream8=_8,
    Stream9=_9,
    Stream10=_10,
    Stream11=_11,
    Stream12=_12,
    Stream13=_13,
    NullGaps=False)  # -> flatten(Weave)
createatts = CreateAttributes(LayerName="hatch_colors", Color=weave, enableFullPath=False)
B = ClusterInput()
C = ClusterInput()
createhatch = CreateHatch(Bake=B, Curves=flatten(C), HatchPatternName="Solid", HatchScale=1, HatchRotation=0, Attributes=createatts)  # -> HatchGeometry, HatchObjects
ho = ClusterOutput(createhatch.HatchObjects)
